# Grasshopper definition algo.gh (Grasshopper 1.0.8)
# plug-ins: RhinoCodePluginGH

number_slider = Slider(4, range=3..20)
number_slider_2 = Slider(10, range=3..20)
twist_angle = Slider(45, range=0..45)
angle = Slider(1, range=1..2.25)
number_slider_3 = Slider(10, range=3..20)
angle_2 = Slider(2.25, range=1..2.25)
twist_angle_2 = Slider(45, range=0..45)
angle_3 = Slider(1, range=1..2.25)
twist_angle_3 = Slider(45, range=0..45)
vec = Vector(Vector(-59.62386765, 57.34406689, 0))
vec_2 = Vector(Vector(55.5459909, 58.1770365, 0))
vec_3 = Vector(Vector(-0.2234905198, 56.06539375, 0))
cluster = Cluster(S=number_slider_2, F=angle, position=vec, A=degrees(twist_angle))
cluster_2 = Cluster(S=number_slider_3, F=angle_3, position=vec_2, A=degrees(twist_angle_3))
cluster_3 = Cluster(S=number_slider, F=angle_2, position=vec_3, A=degrees(twist_angle_2))
concat = Concatenate(FragmentA=number_slider_2, FragmentB=angle, FragmentC=twist_angle, JoinSeparator=",")
concat_2 = Concatenate(FragmentA=number_slider_3, FragmentB=angle_3, FragmentC=twist_angle_3, JoinSeparator=",")
concat_3 = Concatenate(FragmentA=number_slider, FragmentB=angle_2, FragmentC=twist_angle_2, JoinSeparator=",")
panel = Panel("VOTING INPUT")
design_1_voting = Slider(2, range=0..20)
design_2_voting = Slider(20, range=0..20)
design_3_voting = Slider(2, range=0..20)
panel_2 = Panel(concat)
panel_3 = Panel(concat_3)
panel_4 = Panel(concat_2)
dup = DuplicateData(Data=panel_2, Number=design_1_voting, Order=True)
dup_2 = DuplicateData(Data=panel_4, Number=design_3_voting, Order=True)
dup_3 = DuplicateData(Data=panel_3, Number=design_2_voting, Order=True)
panel_5 = Panel(dup)
panel_6 = Panel(dup_3)
panel_7 = Panel(dup_2)
panel_8 = Panel([panel_6, panel_7, panel_5])
lng = ListLength(List=panel_8)
py3 = Python3Script(x=lng)  # -> out
# ---------- py3: Python ----------
import random

r = random.randint(0, x)
print(r)
# ---------- end py3 ----------
py3_2 = Python3Script(x=lng)  # -> out; same code as py3
py3_3 = Python3Script(x=lng)  # -> out; same code as py3
py3_4 = Python3Script(x=lng)  # -> out; same code as py3
py3_5 = Python3Script(x=lng)  # -> out; same code as py3
py3_6 = Python3Script(x=lng)  # -> out; same code as py3
item = ListItem(List=panel_8, Index=py3_2, Wrap=True)
item_2 = ListItem(List=panel_8, Index=py3, Wrap=True)
item_3 = ListItem(List=panel_8, Index=py3_5, Wrap=True)
item_4 = ListItem(List=panel_8, Index=py3_3, Wrap=True)
item_5 = ListItem(List=panel_8, Index=py3_6, Wrap=True)
item_6 = ListItem(List=panel_8, Index=py3_4, Wrap=True)
panel_9 = Panel("MUTATION CONFIG")
mutation_probability = Slider(20, range=0..100)
mutation_range = Slider(10, range=0..100)
panel_10 = Panel(item)
panel_11 = Panel(item_2)
panel_12 = Panel(item_3)
panel_13 = Panel(item_4)
panel_14 = Panel(item_5)
panel_15 = Panel(item_6)
py3_7 = Python3Script(x=panel_10, y=panel_11, z=mutation_probability, u=mutation_range)  # -> out, a, b, c
# ---------- py3_7: Python ----------
import random

x_split = x.split(",")
y_split = y.split(",")

# print("values:", x_split, y_split)

child = []

for index, value in enumerate(x_split):
    if random.choice([True, False]):
        i = float(x_split[index])
    else:
        i = float(y_split[index])
    if random.randint(1, 100) < z:
        deviation = (i / 100) * random.randint(0, u)
        i = i + deviation if random.choice([True, False]) else i - deviation
    if i < 0:
        i = 0
    child.append(str(i))

for i, value in enumerate(child):
    exec(f"{chr(97 + i)} = {value}")

child = ",".join(child)
print(child)
# ---------- end py3_7 ----------
py3_8 = Python3Script(x=panel_12, y=panel_13, z=mutation_probability, u=mutation_range)  # -> out, a, b, c; same code as py3_7
py3_9 = Python3Script(x=panel_14, y=panel_15, z=mutation_probability, u=mutation_range)  # -> out, a, b, c; same code as py3_7
panel_16 = Panel(py3_7.out)
panel_17 = Panel(py3_8.out)
panel_18 = Panel(py3_9.out)
vec_4 = Vector(Vector(53.19676557, -0.1945631876, 0))
vec_5 = Vector(Vector(-0.2485473088, -2.257786579, 0))
vec_6 = Vector(Vector(-57.07619961, -2.550742856, 0))
cluster_4 = Cluster(S=py3_7.a, F=py3_7.b, position=vec_6, A=degrees(py3_7.c))
cluster_5 = Cluster(S=py3_8.a, F=py3_8.b, position=vec_5, A=degrees(py3_8.c))
cluster_6 = Cluster(S=py3_9.a, F=py3_9.b, position=vec_4, A=degrees(py3_9.c))

# ==== cluster Cluster
hight = Panel("20")
floor_thickness = Panel("3")
ground_radius = Panel("10")
S = ClusterInput()
polygon = Polygon(Plane=PlaneXY(0, 0, 0), Radius=ground_radius, Segments=S, FilletRadius=0)  # -> Polygon, Length
Z = UnitZ(Factor=floor_thickness)
Z_2 = UnitZ(Factor=floor_thickness)
rev = Reverse(Vector=Z_2)
move = Move(Geometry=polygon.Polygon, Motion=Z)  # -> Geometry, Transform
Z_3 = UnitZ(Factor=hight)
F = ClusterInput()
scale = Scale(Geometry=move.Geometry, Center=Point(0, 0, 0), Factor=F)  # -> Geometry, Transform
srf = Surface(move.Geometry)
move_2 = Move(Geometry=scale.Geometry, Motion=Z_3)  # -> Geometry, Transform
A = ClusterInput()
extr = Extrude(Base=srf, Direction=rev)
rotate = Rotate(Geometry=move_2.Geometry, Angle=degrees(A), Plane=PlaneXY(0, 0, 0))  # -> Geometry, Transform
position = ClusterInput()
loft = Loft(
    Curves=[rotate.Geometry, move.Geometry],
    Options={Adjust=False, Closed=False, LoftEnds=0, LoftSimp=0, LoftType=0, Rebuild=10, Refit=0.01})
vec = Vector(position)
move_3 = Move(Geometry=extr, Motion=vec)  # -> Geometry, Transform
move_4 = Move(Geometry=loft, Motion=vec)  # -> Geometry, Transform
